# Grasshopper definition Day1-Part1-UI-DataTrees-ListManagement.gh (Grasshopper 1.0.7)
# plug-ins: Bifocals

# Data trees
# Lists
# Sublist
# List index
# Data matching
# DATA TREES
# 
# 1. PARAM VIEWER
number_slider = Slider(3, range=0..10)

panel = Panel("""A
B
C
C1
C2
c3""")
dispatch = Dispatch(List=panel, DispatchPattern=[True, False])  # -> ListA, ListB
panel_2 = Panel(dispatch.ListB)
panel_3 = Panel(dispatch.ListA)

# ----
# TEMPLATE BRANCH IDs
panel_4 = Panel("""A
B
C
D
E
F""")
graft_tree = GraftTree(Tree=panel_4, IncludeEmptyLists=True, IncludeNullItems=True)

panel_5 = Panel()
panel_6 = Panel()

panel_7 = Panel("""A
B
C
C1
C2""")
reverse_list = ReverseList(List=panel_7)
panel_8 = Panel(reverse_list)

series = Series(Start=0, Step=number_slider, Count=Slider(13, range=0..100))

# ----
# 2. WORKING WITH LIST COMPONENTS
panel_9 = Panel("""A
B
C
C1
C2""")
insert_items = InsertItems(List=panel_9, Item="B1", Indices=Slider(2, range=0..10), Wrap=True)
panel_10 = Panel(insert_items)

panel_11 = Panel("""A
B
C
D
E
F""")
panel_12 = Panel("""A1
2
3""")
panel_13 = Panel("""true
false""")

number_slider_2 = Slider(2, range=0..10)
random = Random(Range="0 to 5", Number=number_slider_2, Seed=Slider(2, range=0..10))
panel_14 = Panel(random)

# ----
# 2. WORKING WITH SEQUENCE
panel_15 = Panel("""A
B
C
D
E
F""")
panel_16 = Panel("""A
B
C
D
E
F""")

random_2 = Random(Range="0 to 5", Number=number_slider_2, Seed=Slider(3, range=0..10))
panel_17 = Panel(random_2)

construct_point = ConstructPoint(XCoordinate=0, YCoordinate=series, ZCoordinate=0)  # -> graft(Point)

list_length = ListLength(List=graft_tree)
# combine data based on
# the tree structure of INPUT 1
panel_18 = Panel(list_length)
repeat_data = RepeatData(Data=panel_12, Length=list_length)
panel_19 = Panel(repeat_data)

merge = Merge(Data1=panel_5, Data2=panel_6)
weave = Weave(Pattern=[0, 1], NullGaps=False)
param_viewer = ParamViewer(graft_tree)
cull_nth = CullNth(List=panel_15, CullFrequency=Slider(2, range=0..10))
cull_index = CullIndex(List=panel_15, Indices=Slider(4, range=0..10), Wrap=True)
cull_pattern = CullPattern(List=panel_11, CullPattern=panel_13)
combine_data = CombineData(Input0=panel_12, Input1=graft_tree)  # -> Result, Index
random_reduce = RandomReduce(List=panel_16, Reduction=Slider(3, range=0..10), Seed=Slider(4, range=0..10))
panel_20 = Panel(construct_point)

panel_21 = Panel("""A
B
C
C1
C2""")
shift_list = ShiftList(List=panel_21, Shift=Slider(0, range=0..10), Wrap=Toggle(True))
panel_22 = Panel(shift_list)

panel_23 = Panel(cull_index)
panel_24 = Panel(cull_nth)
panel_25 = Panel(cull_pattern)

point = Point([Point(40.6475321, 25.77814437, 0), Point(58.35219358, 23.97927502, 0), Point(52.5768762, 13.09138159, 0), Point(37.71253474, 9.967029567, 0), Point(38.84866275, 19.24540831, 0), <point referenced from the Rhino model>])
panel_26 = Panel(point)
null_item = NullItem(Item=panel_26)  # -> NullFlags, InvalidFlags, Description
panel_27 = Panel(null_item.NullFlags)

param_viewer_2 = ParamViewer(combine_data.Result)
panel_28 = Panel(combine_data.Result)
panel_29 = Panel(random_reduce)
param_viewer_3 = ParamViewer(panel_20)
param_viewer_4 = ParamViewer(construct_point)
panel_30 = Panel("""1
2
3
45
67.8""")
panel_31 = Panel("""apple
oranges
grapes
banana""")
panel_32 = Panel("""A
B
C
D
E
F""")

panel_33 = Panel(panel_10)
jitter = Jitter(List=panel_10, Jitter=1, Seed=2)  # -> Values, Indices
item_index = ItemIndex(List=simplify(panel_33), Item=jitter.Values)
panel_34 = Panel(item_index)

duplicate_data = DuplicateData(Data=panel_32, Number=Slider(5, range=0..10), Order=Toggle(False))
panel_35 = Panel(duplicate_data)

panel_36 = Panel("""apple
oranges
grapes
banana""")
panel_37 = Panel("""1
2
3
45
67.8""")

panel_38 = Panel("""0
0
1""")
panel_39 = Panel("""A
B
C
D
E
F""")
sift_pattern = SiftPattern(List=panel_39, SiftPattern=panel_38)  # -> Output0, Output1
panel_40 = Panel(sift_pattern.Output1)
panel_41 = Panel(sift_pattern.Output0)

panel_42 = Panel("""true
false
true
false""")
integer = Integer(panel_42)
panel_43 = Panel(integer)

merge_2 = Merge(Data1=panel_30, Data2=panel_31)

panel_44 = Panel("""A
B
C
C1
C2
c3""")

panel_45 = Panel("""0
1
2
4
3
5""")
panel_46 = Panel("""12
2
Ananya
5a
89S
0C""")
sort_list = SortList(Keys=panel_45, ValuesValuesA=panel_46)  # -> Keys, ValuesValuesA
panel_47 = Panel(sort_list.ValuesValuesA)

graft_tree_2 = GraftTree(Tree=panel_37, IncludeEmptyLists=True, IncludeNullItems=True)
graft_tree_3 = GraftTree(Tree=panel_36, IncludeEmptyLists=True, IncludeNullItems=True)
merge_3 = Merge(Data1=graft_tree_2, Data2=graft_tree_3)

construct_point_2 = ConstructPoint(XCoordinate=0, YCoordinate=0, ZCoordinate=0)

point_2 = Point([Point(40.6475321, 25.77814437, 0), Point(58.35219358, 23.97927502, 0), Point(52.5768762, 13.09138159, 0), Point(37.71253474, 9.967029567, 0), Point(38.84866275, 19.24540831, 0), <point referenced from the Rhino model>])
panel_48 = Panel(point_2)
replace_nulls = ReplaceNulls(Items=panel_48, Replacements=construct_point_2)  # -> Items, Count
panel_49 = Panel(replace_nulls.Items)
panel_50 = Panel(replace_nulls.Count)

random_reduce_2 = RandomReduce(Seed=1)
panel_51 = Panel(merge_3)
panel_52 = Panel(merge_2)

fibonacci = Fibonacci(SeedA=Slider(5, range=0..10), SeedB=Slider(2, range=0..10), Number=Slider(5, range=0..10))
construct_point_3 = ConstructPoint(XCoordinate=fibonacci, YCoordinate=fibonacci, ZCoordinate=0)
panel_53 = Panel(fibonacci)
circle = Circle(Plane=construct_point_3, Radius=fibonacci)

pi = Pi(Factor=1)

panel_54 = Panel("""A
B
C
C1
C2""")
list_item = ListItem(List=panel_54, Index=Slider(1, range=0..10), Wrap=True)

# ----
# Right. click and see other options
panel_55 = Panel("""X
Y
Z""")
panel_56 = Panel("""A
B
C
D
E
F""")
longest_list = LongestList(ListListA=panel_56, ListListB=panel_55, PaddingMode=4)  # -> ListListA, ListListB
panel_57 = Panel(longest_list.ListListB)
panel_58 = Panel(longest_list.ListListA)

panel_59 = Panel("""X
Y
Z""")
panel_60 = Panel("""A
B
C
D
E
F""")
shortest_list = ShortestList(ListListA=panel_60, ListListB=panel_59, TrimMode=1)  # -> ListListA, ListListB
panel_61 = Panel(shortest_list.ListListA)
panel_62 = Panel(shortest_list.ListListB)

panel_63 = Panel("""A
B
C
C1
C2""")
split_list = SplitList(List=panel_63, Index=Slider(1, range=0..10))  # -> ListA, ListB
split_list_2 = Panel(split_list.ListA)
panel_64 = Panel(split_list.ListB)

panel_65 = Panel("""A
B
C
D
E
F""")
jitter_2 = Jitter(List=panel_65, Jitter=Slider(1, range=0..100), Seed=Slider(8, range=0..10))  # -> Values, Indices
panel_66 = Panel(jitter_2.Values)

panel_67 = Panel("""1
2
3
45
67.8
35
25
67
98
200
123487""")
panel_68 = Panel("""0
1""")
panel_69 = Panel(list_item)
panel_70 = Panel("""apple
oranges
grapes
banana
oranges
peaches
litchi
blueberries
strawberries""")
panel_71 = Panel("""0
1
1""")

panel_72 = Panel("""A
B
C
C1
C2
67""")
list_length_2 = ListLength(List=panel_72)
panel_73 = Panel(list_length_2)

series_2 = Series(Start=0, Step=1, Count=10)
weave_2 = Weave(Pattern=panel_71, Stream0=panel_67, Stream1=panel_70, NullGaps=False)
panel_74 = Panel("""0
1""")

panel_75 = Panel("""X
Y
Z
Z1""")
panel_76 = Panel("""A
B
C
C1
C2""")
cross_reference = CrossReference(ListListA=panel_76, ListListB=panel_75, CrossMode=1)  # -> ListListA, ListListB
panel_77 = Panel(cross_reference.ListListA)
panel_78 = Panel(cross_reference.ListListB)

panel_79 = Panel(weave_2)

panel_80 = Panel("""A
B
C
C1
C2""")
panel_81 = Panel("0 to 5")
sub_list = SubList(List=panel_80, Domain="0 to 2", Wrap=Toggle(True))  # -> List, Index
sub_list_2 = Panel(sub_list.List)

panel_82 = Panel("""A
B
C
C1
C2
c3""")
partition_list = PartitionList(List=panel_82, Size="4")
partition_list_2 = Panel(partition_list)

panel_83 = Panel("""A
B
C
C1
C2
C3""")
panel_84 = Panel("""X
Y
Z
Z1
Z2
Z3""")
panel_85 = Panel("""1X
1Y
1Z
1Z1
1Z2
1Z3""")
panel_86 = Panel("""0
1
2""")
pick_n_choose = PickNChoose(Pattern=panel_86, Stream0=panel_83, Stream1=panel_84, Stream2=panel_85)
panel_87 = Panel(pick_n_choose)

weave_3 = Weave(Pattern=[0, 1], NullGaps=False)
merge_4 = Merge()

panel_88 = Panel("""A
B
C
C1
C2""")
replace_items = ReplaceItems(List=panel_88, Item="Banana", Indices=Slider(1, range=0..1), Wrap=False)
panel_89 = Panel(replace_items)

panel_90 = Panel("""A
B
C
C1
C2""")
panel_91 = Panel("""X
Y
Z
Z1""")

panel_92 = Panel("""A
B
C
C1
C2
C3""")
panel_93 = Panel("""X
Y
Z
Z1""")

list_length_3 = ListLength(List=panel_92)
repeat_data_2 = RepeatData(Data=panel_93, Length=list_length_3)
panel_94 = Panel(repeat_data_2)

weave_4 = Weave(Pattern=panel_74, Stream0=panel_92, Stream1=repeat_data_2, NullGaps=False)
panel_95 = Panel(weave_4)
