# Grasshopper definition Day1-Part2_CreateGeometry.gh (Grasshopper 1.0.7)

# 02-Transform geometry
curve = Curve(<curve referenced from the Rhino model>)

# ---- group: Primitive components
# Introduction to Robotic 3D printing
# DAY 1 - Part 2- IntroductionTo Grasshopper
# Notes: You can double click this and add your class notes here !
# Refer previous session: User Interface, Math operations, Data structure
# 01-Create geometry
sphere = Sphere(Base=PlaneXY(0, 0, 0), Radius=1)
cylinder = Cylinder(Base=PlaneXY(0, 0, 0), Radius=0.5, Length=1)
box_2pt = Box2Pt(Plane=PlaneXY(0, 0, 0))

# ----
area = Area(Geometry=curve)  # -> Area, Centroid
curve_2 = Curve(<curve referenced from the Rhino model>)
point = Point(Point(221.1741676, 0, -1.920532198))
range = Range(Domain=Domain(0, 1), Steps=expr("x-1", Slider(100, range=0..100)))
area_2 = Area(Geometry=curve_2)  # -> Area, Centroid
unit_z = UnitZ(Factor=Slider(100, range=0..100))
range_2 = Range(Domain="0.1 to 1.5", Steps=Slider(10, range=0..10))
rotate = Rotate(Geometry=curve, Angle=degrees(Slider(134, range=0..1000)), Plane=area.Centroid)  # -> Geometry, Transform
circle = Circle(Plane=point, Radius=Slider(27, range=0..100))
unit_z_2 = UnitZ(Factor=Slider(10, range=0..10))
curve_3 = Curve(<curve referenced from the Rhino model>)
curve_4 = Curve(<curve referenced from the Rhino model>)
graph_mapper = GraphMapper(range, x0=0, x1=1, y0=0, y1=1, container_name="Sine", Equation_px=[0.5642027855, 1], Equation_py=[0, 1])
linear_array = LinearArray(Geometry=curve_3, Direction=unit_z_2, Count=Slider(8, range=0..10))  # -> Geometry, Transform
scale = Scale(Geometry=curve_2, Center=area_2.Centroid, Factor=range_2)  # -> Geometry, Transform
move = Move(Geometry=circle, Motion=unit_z)  # -> Geometry, Transform
# Note: Try other rotate geom. commands !
loft = Loft(
    Curves=[rotate.Geometry, curve_4],
    Options={Adjust=False, Closed=False, LoftEnds=0, LoftSimp=0, LoftType=0, Rebuild=10, Refit=0.01})
bounds = Bounds(Numbers=range_2)
input_curve = Curve(<curve referenced from the Rhino model>)
curve_5 = Curve(<curve referenced from the Rhino model>)
curve_6 = Curve(<curve referenced from the Rhino model>)

# ---- group: Scaling factor
bounds_2 = Bounds(Numbers=graph_mapper)
remap_numbers = RemapNumbers(Value=graph_mapper, Source=bounds_2, Target="0.5 to 1.5")  # -> Mapped, Clipped

# ----
list_length = ListLength(List=range)
remap_numbers_2 = RemapNumbers(Value=range_2, Source=bounds, Target="200 to 2")  # -> Mapped, Clipped
loft_2 = Loft(
    Curves=[curve_5, curve_6],
    Options={Adjust=False, Closed=False, LoftEnds=0, LoftSimp=0, LoftType=0, Rebuild=10, Refit=0.01})
area_3 = Area(Geometry=input_curve)  # -> Area, Centroid
series = Series(Start=Slider(2, range=0..10), Step=Slider(2, range=0..10), Count=list_length)
unit_z_3 = UnitZ(Factor=remap_numbers_2.Mapped)
surface = Surface(loft_2)
scale_2 = Scale(Geometry=input_curve, Center=area_3.Centroid, Factor=remap_numbers.Mapped)  # -> Geometry, Transform
panel = Panel(series)
unit_z_4 = UnitZ(Factor=series)
curve_7 = Curve(<curve referenced from the Rhino model>)
move_2 = Move(Geometry=scale.Geometry, Motion=unit_z_3)  # -> Geometry, Transform
sweep1 = Sweep1(Rail=curve_7, Miter=1)
move_3 = Move(Geometry=scale_2.Geometry, Motion=unit_z_4)  # -> Geometry, Transform
brep = Brep()
# Go ahead and try spiralizing
# in the next stage
curve_8 = Curve(move_3.Geometry)
rail_1 = Curve(<curve referenced from the Rhino model>)
rail_2 = Curve(<curve referenced from the Rhino model>)
section_crv = Curve(<curve referenced from the Rhino model>)
flip_curve = FlipCurve(Curve=rail_1, Guide=rail_2)  # -> Curve, Flag
sweep2 = Sweep2(Rail1=flip_curve.Curve, Rail2=rail_2, Sections=section_crv, SameHeight=False)
brep_2 = Brep(sweep2)
