# Grasshopper definition Day1-Part3_PRCworkflow.gh (Grasshopper 1.0.7)
# plug-ins: KUKA|prc - parametric robot control

# ---- group: Gcode import worksflow
pt = Point(<point referenced from the Rhino model>)
path = FilePath()
import_g_code = GCodeImportFor3DPrintingKUKAPrc(
    Path=path,
    TolerancePointsInCartesianSpace=Slider(0.5, range=0.5..2),
    ToleranceExtrusionSpeed=0,
    ExtrusionMode="E1",
    OrientationPoint=pt,
    interpolation="C_DIS")

# ---- group: Simple curve
# Introduction to Robotic 3D printing
# DAY 1 - Part 3- KUKA PRC workflow
# Notes: You can double click this and add your class notes here !
crv = Curve(<curve referenced from the Rhino model>)
divide = DivideCurve(Curve=crv, Count=10, Kinks=False)  # -> Points, Tangents, Parameters
xy = XYPlane(Origin=divide.Points)
lin_move = LINearMovementKUKAPrc(TargetAsPlane=xy, extaxenabled=False, interpolation="C_DIS")

# ---- group: PRC SETUP
geo = Geometry(<mesh referenced from the Rhino model>)
custom_tool = CustomToolKUKAPrc(
    CustomToolGeometry=geo,
    isExternal=False,
    toolid=2,
    toolvala=0,
    toolvalb=0,
    toolvalc=0,
    toolvalx=224.926,
    toolvaly=-12.968,
    toolvalz=86.87,
    valuesset=True)
kr6_10_r1100 = AgilusKR610R1100Robot(infiniterot=False)
kuka_prc = KUKAPrcCORE(
    SimulationSlider=Slider(1, range=0..1),
    KUKAPrcCommands=lin_move,
    Tool=custom_tool,
    Robot=kr6_10_r1100,
    PRC_BaseExpose=False,
    PRC_SaveNameExpose=False,
    PRCsettings="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")  # -> RobotGeometry, AnalysisOutput
